vi "A3.gvi"   [LabVIEW NXG]
inputs:
  "y": waveform<f64> = {dt=0.1, Y=[]}
  "ka": f64
outputs:
  "modulé": waveform<f64>
diagram:
  w1 = 20000000  # fc
  call "MT Modulate AM (DSB).gvi"(message signal=$y, modulation index=$ka, suppress carrier?=TRUE) -> (am modulated waveform=w2)
  call "MT Upconvert Baseband (Real).gvi"(baseband waveform=w2, carrier frequency=w1) -> (passband waveform=w3)
  $modulé <- w3
