vi "Démodulateur_Cohérent.gvi"   [LabVIEW NXG]
inputs:
  "y": waveform<f64> = {dt=0.1, Y=[]}
  "ka": f64
outputs:
  "démodulé": waveform<f64>
  "démodulé (downconverted)": cluster{"t0": f64, "dt": f64, "Y": c128[]}
diagram:
  w1 = 20000000  # fc
  call "MT Downconvert Passband (Real).gvi"(waveform=$y, carrier frequency=w1, passband bandwidth=1000000) -> (downconverted waveform=w2)
  $"démodulé (downconverted)" <- w2
  call "MT Demodulate AM (DSB).gvi"(am modulated waveform=w2, modulation index=$ka, suppressed carrier?=FALSE) -> (am demodulated waveform=w3)
  $démodulé <- w3
