vi "synchronize.gvi"   [LabVIEW NXG]
inputs:
  "Modulation Parameters In": T6 = {"Modulation Type"="QPSK", "Control Information\nfor Packet Header/Tail"={"Training Sequence (derived)"=[], "Zero Pad Length"=0}, "RX Oversample Factor"=20, "Synchronization Options"={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}, "Number of Data Symbols (Derived)"=100, "RX Sample Rate"=4000000, "Pulse Shaping Parameters"={"Modulation Type"="PSK", "Pulse Shaping Filter"="Root Raised Cos", "Filter Parameter"=0.5, "Filter Length (Symbols)"=8}, "Channel Estimation/Equalization Parameters"={"Equalization Method"="", "Channel Estimate Length"=1, "Equalizer Length"=1, "Equalizer Delay"=-1}}
  "Input Complex Waveform": cluster{"t0": f64, "dt": f64, "Y": c128[]}
  "error in (no error)": error
outputs:
  "Modulation Parameters Out": T6
  "Output Complex Symbols": c128[]
  "Offset": i32
  "error out": error
  "Intermediate Complex Waveform": cluster{"t0": f64, "dt": f64, "Y": c128[]}
  "Channel Estimate": c128[]
  "Estimated Frequency Offset": f64
types:
  T1 = cluster{"Training Sequence (derived)": c128[], "Zero Pad Length": i32}
  T2 = cluster{"Synchronization Method": string, "Fixed Offset": i32, "Symbol Timing Recovery Method": string, "Frame Detection Method": string, "Correct Frequency Offset": bool}
  T3 = enum{"none", "Raised Cosine", "Root Raised Cos", "Gaussian"}
  T4 = cluster{"Modulation Type": enum{"FSK", "PSK", "QAM", "MSK", "PAM", "ASK"}, "Pulse Shaping Filter": T3, "Filter Parameter": f64, "Filter Length (Symbols)": i32}
  T5 = cluster{"Equalization Method": string, "Channel Estimate Length": i32, "Equalizer Length": i32, "Equalizer Delay": i32}
  T6 = cluster{"Modulation Type": string, "Control Information\nfor Packet Header/Tail": T1, "RX Oversample Factor": i32, "Synchronization Options": T2, "Number of Data Symbols (Derived)": i32, "RX Sample Rate": f64, "Pulse Shaping Parameters": T4, "Channel Estimation/Equalization Parameters": T5}
diagram:
  $"Modulation Parameters Out" <- $"Modulation Parameters In"
  case ($"error in (no error)") {
    frame No Error {
      # Recover symbol timing, perform frame detection, and estimate frequency offset correction
      Property Node(instance in=$"Modulation Parameters In") -> ("Synchronization Options:Synchronization Method"=w2)
      case (w2) {
        frame "Timing Estimation" {
          call "symbol_timing.gvi"(Modulation Parameters In=$"Modulation Parameters In", Input Complex Waveform=$"Input Complex Waveform", error in (no error)=$"error in (no error)") -> (Modulation Parameters Out=w7, Output Complex Waveform=w8, Alignment Offset=w9, error out=w10)
          Property Node(instance in=$"Modulation Parameters In") -> ("RX Oversample Factor"=w11)
          call "frame_detect.gvi"(Modulation Parameters In=w7, Input Complex Waveform=w8, error in (no error)=w10) -> (Output=w3, Frame Offset=w12, Frequency Offset=w6, error out=w1)
          Multiply(w12, w11) -> w13
          Add(w9, w13) -> w14
          To Long Integer(number=w14) -> w4
          w5 = c128[] []
        }
        frame "Fixed Offset", Default {
          call "symbol_timing.gvi"(Modulation Parameters In=$"Modulation Parameters In", Input Complex Waveform=$"Input Complex Waveform", error in (no error)=$"error in (no error)") -> (Output Complex Waveform=w15, Alignment Offset=w16, error out=w1)
          Property Node(instance in=w15) -> ("Y"=w3)
          To Long Integer(number=w16) -> w4
          w5 = c128[] []
          w6 = 0
        }
        frame "Joint Timing and Channel Estimation" {
          call "joint_estimation.gvi"(Modulation Parameters=$"Modulation Parameters In", Input Complex Waveform=$"Input Complex Waveform", error in (no error)=$"error in (no error)") -> (Recovered Complex Symbols=w3, Frequency Offset=w6, Total Offset=w4, error out=w1, Channel Estimate=w5)
        }
      }
      Property Node(instance in=$"Input Complex Waveform") -> ("Y"=w17)
      Delete From Array(inArray=w17, length (1)=w4, index0=0) -> w18
      Property Node(instance in=$"Input Complex Waveform", "t0"=0, "Y"=w18) -> (instance out=w19)
      # Get intermediate waveform for eye diagram graph
      $"Intermediate Complex Waveform" <- w19
      $"Output Complex Symbols" <- w3
      $"Estimated Frequency Offset" <- w6
      $Offset <- w4
      $"Channel Estimate" <- w5
    }
    frame Error {
      w1 = $"error in (no error)"
    }
  }
  $"error out" <- w1
