vi "student_modulate.gvi"   [LabVIEW NXG]
inputs:
  "Modulation Parameters In": T4 = {"Modulation Type"="QPSK", "Pulse Shaping Parameters"={"Modulation Type"="PSK", "Pulse Shaping Filter"="Root Raised Cos", "Filter Parameter"=0.5, "Filter Length (Symbols)"=8}, "TX Oversample Factor"=20, "Packet Length (Bits)"=500, "TX Sample Rate"=100, "Control Information For Packet Header/Tail"={"Training Sequence "="Length 11 Barker Sequence", "Zero Pad Length"=8}}
  "Input Bit Stream": u8[]
  "Error In": error
outputs:
  "Modulation Parameters Out": T4
  "Output Symbols": c128[]
  "Error Out": error
types:
  T1 = enum{"none", "Raised Cosine", "Root Raised Cos", "Gaussian"}
  T2 = cluster{"Modulation Type": enum{"FSK", "PSK", "QAM", "MSK", "PAM", "ASK"}, "Pulse Shaping Filter": T1, "Filter Parameter": f64, "Filter Length (Symbols)": i32}
  T3 = cluster{"Training Sequence ": string, "Zero Pad Length": i32}
  T4 = cluster{"Modulation Type": string, "Pulse Shaping Parameters": T2, "TX Oversample Factor": i32, "Packet Length (Bits)": i32, "TX Sample Rate": f64, "Control Information For Packet Header/Tail": T3}
diagram:
  $"Modulation Parameters Out" <- $"Modulation Parameters In"
  case ($"Error In") {
    frame No Error, Default {
      Property Node(instance in=$"Modulation Parameters In") -> ("Modulation Type"=w3)
      case (w3) {
        frame "BPSK" {
          Square Root(x=2) -> w4
          Decimate Array(array=$"Input Bit Stream") -> (out0=w5)  # Decimate 1D Array
          To Double Precision Float(number=w5) -> w6
          Multiply(w6, 2) -> w7
          Subtract(x=w7, y=1) -> w8
          Divide(x=w8, y=w4) -> w2
        }
        frame "QPSK" {
          w2 = _
        }
      }
      w1 = $"Error In"
    }
    frame Error {
      w1 = $"Error In"
      w2 = c128[] []
    }
  }
  $"Output Symbols" <- w2
  $"Error Out" <- w1
