vi "Démodulateur_Cohérent.gvi"   [LabVIEW NXG]
inputs:
  "y": waveform<f64> = {dt=0.1, Y=[]}
outputs:
  "démodulé": waveform<f64>
  "démodulé (downconverted)": cluster{"t0": f64, "dt": f64, "Y": c128[]}
diagram:
  w1 = 2000000  # fc
  call "MT Downconvert Passband (Real).gvi"(waveform=$y, carrier frequency=w1, passband bandwidth=5000) -> (downconverted waveform=w2)
  $"démodulé (downconverted)" <- w2
  w3 = 25000  # kf
  call "MT Demodulate FM.gvi"(fm modulated waveform=w2, fm deviation=w3) -> (fm demodulated waveform=w4)
  $démodulé <- w4
