vi "Function.gvi"   [LabVIEW NXG]
panel indicators:
  "Graph": f64[]
  "Modulant": waveform<f64>
  "abs(FFT)": cluster{"y": f64, "f0": f64, "d0": f64[]}
  "démodulé (downconverted)": cluster{"t0": f64, "dt": f64, "Y": c128[]}
  "démodulé": waveform<f64>
  "Abs": waveform<f64>
  "Filtered": waveform<f64>
diagram:
  w1 = 200000000  # fs
  w2 = 2e-05  # T
  Multiply(w2, w1) -> w3
  Round To Nearest(number=w3) -> w4
  To Long Integer(number=w4) -> w5
  for (N = w5) (iteration -> i1) {
    Reciprocal(x=w1) -> w7
    To Double Precision Float(number=i1) -> w8
    Multiply(w7, w8) -> w9
    append w9 to w6
  }
  $Graph <- w6
  Reciprocal(x=w1) -> w10
  Multiply(w6, PiTimes2, 400000) -> w11
  Cosine(x=w11) -> w12
  Multiply(1, w12) -> w13
  Build Waveform Node(Y=w13, dt=w10) -> (output waveform=w14)
  $Modulant <- w14
  call "FFT.gvi"(T=w2, y=w14) -> (FFT=w15)
  $"abs(FFT)" <- w15
  call "A3.gvi"(y=w14) -> (modulé=w16)
  call "Démodulateur_Cohérent.gvi"(y=w16) -> (démodulé=w17, démodulé (downconverted)=w18)
  $démodulé <- w17
  $"démodulé (downconverted)" <- w18
  call "Détecteur de crête.gvi"(modulé=w16, fs=w1) -> (Abs=w19, Filtered=w20)
  $Abs <- w19
  $Filtered <- w20
